# Grasshopper definition Bending_actuator.gh (Grasshopper 1.0.7)

number_slider = Slider(6, range=0..10)
number_slider_2 = Slider(120, range=0..200)
addition = Addition(A=number_slider_2, B="4")
number_slider_3 = Slider(40, range=0..100)
addition_2 = Addition(A=number_slider_3, B="4")
number_slider_4 = Slider(10, range=0..20)
construct_domain = ConstructDomain(DomainStart="-4", DomainEnd=addition)
construct_domain_2 = ConstructDomain(DomainStart="-4", DomainEnd=addition_2)
division = Division(A=number_slider_2, B=number_slider)
division_2 = Division(A=number_slider_3, B=Slider(2, range=0..10))
rectangle = Rectangle(Plane=PlaneXY(0, 0, 0), XSize=number_slider_2, YSize=number_slider_3, Radius=0)  # -> Rectangle, Length
rectangle_2 = Rectangle(Plane=PlaneXY(0, 0, 0), XSize=construct_domain, YSize=construct_domain_2, Radius=0)  # -> Rectangle, Length
subtraction = Subtraction(A=division_2, B=number_slider_4)
addition_3 = Addition(A=division_2, B=number_slider_4)
construct_point = ConstructPoint(XCoordinate=division, YCoordinate=subtraction, ZCoordinate=0)
construct_point_2 = ConstructPoint(XCoordinate=division, YCoordinate=addition_3, ZCoordinate=0)
series = Series(Start=0, Step=division, Count=expr("x-1", number_slider))  # -> graft(Series)
divide_length = DivideLength(Curve=rectangle_2.Rectangle, Length=Slider(1, range=0..1))  # -> Points, Tangents, Parameters
line = Line(StartPoint=construct_point, EndPoint=construct_point_2)
unit_x = UnitX(Factor=series)
deconstruct_vector = DeconstructVector(Vector=divide_length.Tangents)  # -> XComponent, YComponent, ZComponent
number_slider_5 = Slider(1, range=0..1)
move = Move(Geometry=line, Motion=unit_x)  # -> Geometry, Transform
expression = Expression(x=deconstruct_vector.XComponent, y=deconstruct_vector.YComponent, Expression="if(y<0,2*pi+atan2(y,x),atan2(y,x))")
deconstruct = Deconstruct(Point=divide_length.Points)  # -> XComponent, YComponent, ZComponent
divide_length_2 = DivideLength(Curve=rectangle.Rectangle, Length=number_slider_5)  # -> Points, Tangents, Parameters
divide_length_3 = DivideLength(Curve=move.Geometry, Length=number_slider_5)  # -> Points, Tangents, Parameters
subtraction_2 = Subtraction(A=deconstruct.XComponent, B=27.6313)
subtraction_3 = Subtraction(A=deconstruct.YComponent, B=110.475)
list_item = ListItem(List=divide_length_2.Points, Index="-1", Wrap=True)
degrees = Degrees(Radians=expression)
unit_z = UnitZ(Factor=Slider(10, range=0..20))
ghpython_script = GhPythonScript(deg=degrees)  # -> out, a; inputs deg: list
# ---------- ghpython_script: Python ----------
# Input: deg - List of degree values (angles) from Grasshopper

# Step 1: Ensure deg is a list of floats (convert strings to floats)
deg = [float(x) for x in deg]  # Convert all input values to floats

# Step 2: Add an initial value of 0 at the start of the list
deg = [0.0] + deg  # Ensure initial value is a float

# Step 3: Initialize the final_deg list as a copy of deg
final_deg = deg[:]  # Create a copy using slicing

# Step 4: Initialize index tracking and b value
index = []  # To store the indices where adjustments occur
b = 1  # Index tracker

# Step 5: Loop through the degrees, starting from the second element
for i in range(1, len(deg)):  # Remember, Python indices are 0-based, so adjust accordingly
    if abs(deg[i] - deg[i - 1]) > 300:
        index.append(i)  # Save the index where the change happens
        if deg[i] - deg[i - 1] < 0:
            # If there's a large negative delta, add 360 to the remaining elements
            for j in range(i, len(final_deg)):
                final_deg[j] += 360
        elif deg[i] - deg[i - 1] > 0:
            # If there's a large positive delta, subtract 360 from the remaining elements
            for j in range(i, len(final_deg)):
                final_deg[j] -= 360

# Output the final corrected degrees and the index values
a = final_deg  # 'a' is the output for the final corrected degrees
b = index      # 'b' is the output for the indices where adjustments happened
# ---------- end ghpython_script ----------
list_item_2 = ListItem(List=divide_length_3.Points, Index=0, Wrap=True)
list_item_3 = ListItem(List=divide_length_3.Points, Index="-1", Wrap=True)
move_2 = Move(Geometry=list_item, Motion=unit_z)  # -> Geometry, Transform
split_list = SplitList(List=ghpython_script.a, Index=Slider(1, range=0..1))  # -> ListA, ListB
panel = Panel(split_list.ListB)
expression_2 = Expression(
    x=subtraction_2,
    y=subtraction_3,
    z=deconstruct.ZComponent,
    A=panel,
    Expression="Format(\"G1 X{0:0.00} Y{1:0.00} Z{2:0.00} A{3:0.00} F600\", x, y, z, A)")
path_mapper = PathMapper(move_2.Geometry, source="{0;0}", target="{0;1}")
move_3 = Move(Geometry=list_item_2, Motion=unit_z)  # -> Geometry, Transform
move_4 = Move(Geometry=list_item_3, Motion=unit_z)  # -> Geometry, Transform
path_mapper_2 = PathMapper(divide_length_3.Points, source="{0;0;A;0}", target="{0;3*A+3}")
path_mapper_3 = PathMapper(move_3.Geometry, source="{0;0;A;0}", target="{0;3*A+2}")
path_mapper_4 = PathMapper(move_4.Geometry, source="{0;0;A;0}", target="{0;3*A+4}")
panel_2 = Panel([divide_length_2.Points, path_mapper])
panel_3 = Panel(path_mapper_3)
panel_4 = Panel(path_mapper_2)
panel_5 = Panel(path_mapper_4)
panel_6 = Panel([panel_2, panel_3, panel_4, panel_5])
radians = Radians(Degrees=Slider(0.1, range=0..1))
negative = Negative(Value=radians)
yz_plane = YZPlane(Origin=Point(0, 0, 0))
radians_2 = Radians(Degrees=Slider(0.11, range=0..0.12))
negative_2 = Negative(Value=radians_2)
rotate = Rotate(Geometry=panel_6, Angle=negative, Plane=yz_plane)  # -> Geometry, Transform
xz_plane = XZPlane(Origin=Point(0, 0, 0))
rotate_2 = Rotate(Geometry=rotate.Geometry, Angle=negative_2, Plane=xz_plane)  # -> Geometry, Transform
deconstruct_2 = Deconstruct(Point=rotate_2.Geometry)  # -> XComponent, YComponent, ZComponent
expression_3 = Expression(
    x=deconstruct_2.XComponent,
    y=deconstruct_2.YComponent,
    z=deconstruct_2.ZComponent,
    Expression="Format(\"G1 X{0:0.00} Y{1:0.00} Z{2:0.00} F120\", x, y, z)")
panel_7 = Panel(expression_3)
panel_8 = Panel(expression_2)
