# Grasshopper definition Contraction_kirigami.gh (Grasshopper 1.0.7)

number_slider = Slider(30, range=0..100)
number_slider_2 = Slider(4, range=0..10)
division = Division(A=number_slider, B=3)
division_2 = Division(A=Slider(150, range=50..150), B=2)
division_3 = Division(A=number_slider, B=3)
subtraction = Subtraction(A=division_2, B=division)
construct_domain = ConstructDomain(DomainStart=division_3, DomainEnd=division_2)
construct_domain_2 = ConstructDomain(DomainStart=expr("x+3", division), DomainEnd=expr("2*x-3", division))
construct_domain_3 = ConstructDomain(DomainStart=expr("-x+1", subtraction), DomainEnd=expr("x-1", subtraction))

number_slider_3 = Slider(5, range=0..10)
number_slider_4 = Slider(60, range=0..100)
expression = Expression(x=number_slider, n=number_slider_2, Expression="(n+((n-1)/3))*x")
addition = Addition(A=division_2, B=number_slider_3)
negative = Negative(Value=addition)
addition_2 = Addition(A=expression, B=number_slider_3)
negative_2 = Negative(Value=number_slider_3)
construct_domain_4 = ConstructDomain(DomainStart=negative, DomainEnd=addition)
construct_domain_5 = ConstructDomain(DomainStart=negative_2, DomainEnd=addition_2)
rectangle = Rectangle(Plane=PlaneXY(0, 0, 0), XSize=construct_domain_5, YSize=construct_domain_4, Radius=0)  # -> Rectangle, Length
number_slider_5 = Slider(0.5, range=0..1)
divide_length = DivideLength(Curve=rectangle.Rectangle, Length=number_slider_5)  # -> Points, Tangents, Parameters

multiplication = Multiplication(A=number_slider, B=1.333333333)
rectangle_2 = Rectangle(Plane=PlaneXY(0, 0, 0), XSize=number_slider, YSize=construct_domain, Radius=0)  # -> Rectangle, Length
rectangle_3 = Rectangle(Plane=PlaneXY(0, 0, 0), XSize=construct_domain_2, YSize=construct_domain_3, Radius=0)  # -> Rectangle, Length
series = Series(Start=0, Step=multiplication, Count=number_slider_2)
explode = Explode(Curve=rectangle_2.Rectangle, Recursive=True)  # -> Segments, Vertices
unit_x = UnitX(Factor=series)
move = Move(Geometry=rectangle_3.Rectangle, Motion=unit_x)  # -> Geometry, Transform
cull_index = CullIndex(List=explode.Segments, Indices="0", Wrap=True)
join_curves = JoinCurves(Curves=cull_index, Preserve=False)

area = Area(Geometry=move.Geometry)  # -> Area, Centroid
deconstruct = Deconstruct(Point=area.Centroid)  # -> XComponent, YComponent, ZComponent
subtraction_2 = Subtraction(A=deconstruct.YComponent, B=number_slider_4)
addition_3 = Addition(A=deconstruct.YComponent, B=number_slider_4)
construct_point = ConstructPoint(XCoordinate=deconstruct.XComponent, YCoordinate=subtraction_2, ZCoordinate=0)
construct_point_2 = ConstructPoint(XCoordinate=deconstruct.XComponent, YCoordinate=addition_3, ZCoordinate=0)
line = Line(StartPoint=construct_point, EndPoint=construct_point_2)
divide_length_2 = DivideLength(Curve=line, Length=number_slider_5)  # -> Points, Tangents, Parameters
list_item = ListItem(List=divide_length_2.Points, Index="0", Wrap=True)
list_item_2 = ListItem(List=divide_length_2.Points, Index="-1", Wrap=True)
path_mapper = PathMapper(divide_length_2.Tangents, source="{0;0;A}", target="{9*A+1}")
path_mapper_2 = PathMapper(divide_length_2.Points, source="{0;0;A}", target="{9*A+1}")
path_mapper_3 = PathMapper(list_item, source="{0;0;A}", target="{9*A+0}")
path_mapper_4 = PathMapper(list_item_2, source="{0;0;A}", target="{9*A+2}")

divide_length_3 = DivideLength(Curve=move.Geometry, Length=Slider(0.5, range=0..1))  # -> Points, Tangents, Parameters
flip_curve = FlipCurve(Curve=join_curves)  # -> Curve, Flag
construct_point_3 = ConstructPoint(XCoordinate=0, YCoordinate=0, ZCoordinate=0)
move_2 = Move(Geometry=flip_curve.Curve, Motion=unit_x)  # -> Geometry, Transform
list_item_3 = ListItem(List=divide_length_3.Points, Index="0", Wrap=True)
unit_z = UnitZ(Factor=Slider(5, range=0..10))
divide_curve = DivideCurve(Curve=move_2.Geometry, Count=Slider(500, range=0..500), Kinks=False)  # -> flatten(Points), Tangents, Parameters
move_3 = Move(Geometry=list_item_3, Motion=unit_z)  # -> Geometry, Transform
xz_plane = XZPlane(Origin=Point(0, 0, 0))
mirror = Mirror(Geometry=divide_curve.Points, Plane=xz_plane)  # -> reverse(Geometry), Transform
pipe = Pipe(Curve=rectangle.Rectangle, Radius=1, Caps=0)
path_mapper_5 = PathMapper(divide_curve.Points, source="{0}", target="{1}")
path_mapper_6 = PathMapper(mirror.Geometry, source="{0}", target="{2}")
path_mapper_7 = PathMapper(construct_point_3, source="{0}", target="{3}")
pipe_2 = Pipe(Curve=line, Radius=1, Caps=0)
path_mapper_8 = PathMapper(move_3.Geometry, source="{0;0;A}", target="{3*A+3}")
path_mapper_9 = PathMapper(divide_length_3.Points, source="{0;0;A}", target="{3*A+4}")
path_mapper_10 = PathMapper(move_3.Geometry, source="{0;0;A}", target="{3*A+5}")
point = Point([construct_point_3, path_mapper_5, path_mapper_6, path_mapper_7])
panel = Panel([path_mapper_8, path_mapper_9, path_mapper_10])
polyline = PolyLine(Vertices=flatten(point), Closed=False)
divide_length_4 = DivideLength(Curve=polyline, Length=Slider(0.5, range=0..1))  # -> Points, Tangents, Parameters
panel_2 = Panel(divide_length_4.Points)
list_item_4 = ListItem(List=divide_length_4.Points, Index="0", Wrap=True)
path_mapper_11 = PathMapper(panel_2, source="{0;A}", target="{1}")
path_mapper_12 = PathMapper(list_item_4, source="{0;A}", target="{0}")
path_mapper_13 = PathMapper(list_item_4, source="{0;A}", target="{2}")
panel_3 = Panel([path_mapper_12, path_mapper_11, path_mapper_13, panel])
radians = Radians(Degrees=Slider(0, range=0..8))
polyline_2 = PolyLine(Vertices=panel_3, Closed=False)
yz_plane = YZPlane(Origin=Point(0, 0, 0))
radians_2 = Radians(Degrees=Slider(0.03, range=0..0.1))
pipe_3 = Pipe(Curve=polyline_2, Radius=Slider(0.5, range=0..1), Caps=0)
negative_3 = Negative(Value=radians_2)
rotate = Rotate(Geometry=panel_3, Angle=radians, Plane=yz_plane)  # -> Geometry, Transform
custom_preview = CustomPreview(Geometry=pipe_3, Material=ColourSwatch(SwatchColor=RGB(0, 0, 255)))
xz_plane_2 = XZPlane(Origin=Point(0, 0, 0))
rotate_2 = Rotate(Geometry=rotate.Geometry, Angle=negative_3, Plane=xz_plane_2)  # -> Geometry, Transform
deconstruct_2 = Deconstruct(Point=panel_3)  # -> XComponent, YComponent, ZComponent
expression_2 = Expression(
    x=deconstruct_2.XComponent,
    y=deconstruct_2.YComponent,
    z=deconstruct_2.ZComponent,
    Expression="Format(\"G1 X{0:0.00} Y{1:0.00} Z{2:0.00} F120\", x, y, z)")
panel_4 = Panel(expression_2)

division_4 = Division(A=multiplication, B=2)
addition_4 = Addition(A=deconstruct.XComponent, B=division_4)
cull_index_2 = CullIndex(List=addition_4, Indices="-1", Wrap=True)
subtraction_3 = Subtraction(A=addition, B=number_slider_4)
construct_point_4 = ConstructPoint(XCoordinate=cull_index_2, YCoordinate=addition, ZCoordinate=0)
xz_plane_3 = XZPlane(Origin=Point(0, 0, 0))

subtraction_4 = Subtraction(A=subtraction_3, B=number_slider_3)

construct_point_5 = ConstructPoint(XCoordinate=cull_index_2, YCoordinate=subtraction_4, ZCoordinate=0)
line_2 = Line(StartPoint=construct_point_4, EndPoint=construct_point_5)
mirror_2 = Mirror(Geometry=line_2, Plane=xz_plane_3)  # -> Geometry, Transform
divide_length_5 = DivideLength(Curve=line_2, Length=number_slider_5)  # -> Points, Tangents, Parameters
divide_length_6 = DivideLength(Curve=mirror_2.Geometry, Length=number_slider_5)  # -> Points, Tangents, Parameters
list_item_5 = ListItem(List=divide_length_5.Points, Index="0", Wrap=True)
list_item_6 = ListItem(List=divide_length_6.Points, Index="0", Wrap=True)
list_item_7 = ListItem(List=divide_length_6.Points, Index="-1", Wrap=True)
list_item_8 = ListItem(List=divide_length_5.Points, Index="-1", Wrap=True)
path_mapper_14 = PathMapper(list_item_5, source="{0;0;0;A}", target="{9*A+3}")
path_mapper_15 = PathMapper(list_item_7, source="{0;0;0;A}", target="{9*A+8}")
path_mapper_16 = PathMapper(list_item_6, source="{0;0;0;A}", target="{9*A+6}")
path_mapper_17 = PathMapper(list_item_8, source="{0;0;0;A}", target="{9*A+5}")
path_mapper_18 = PathMapper(divide_length_5.Points, source="{0;0;0;A}", target="{9*A+4}")
path_mapper_19 = PathMapper(divide_length_5.Tangents, source="{0;0;0;A}", target="{9*A+4}")
path_mapper_20 = PathMapper(divide_length_6.Points, source="{0;0;0;A}", target="{9*A+7}")
path_mapper_21 = PathMapper(divide_length_6.Tangents, source="{0;0;0;A}", target="{9*A+7}")

pipe_4 = Pipe(Curve=line_2, Radius=1, Caps=0)
pipe_5 = Pipe(Curve=mirror_2.Geometry, Radius=1, Caps=0)
custom_preview_2 = CustomPreview(Geometry=[pipe_2, pipe_4, pipe, pipe_5], Material=ColourSwatch(SwatchColor=RGB(255, 0, 0)))

deconstruct_3 = Deconstruct(Point=[path_mapper_14, path_mapper_17, path_mapper_16, path_mapper_15, path_mapper_3, path_mapper_4])  # -> XComponent, YComponent, ZComponent
deconstruct_vector = DeconstructVector(Vector=[path_mapper_19, path_mapper_21, path_mapper])  # -> XComponent, YComponent, ZComponent
deconstruct_4 = Deconstruct(Point=[path_mapper_18, path_mapper_20, path_mapper_2])  # -> XComponent, YComponent, ZComponent
subtraction_5 = Subtraction(A=deconstruct_3.XComponent, B=29.1688)
subtraction_6 = Subtraction(A=deconstruct_3.YComponent, B=109.225)
addition_5 = Addition(A=deconstruct_3.ZComponent, B=Slider(10, range=0..10))
expression_3 = Expression(x=deconstruct_vector.XComponent, y=deconstruct_vector.YComponent, Expression="if(y<0,2*pi+atan2(y,x),atan2(y,x))")
expression_4 = Expression(x=subtraction_5, y=subtraction_6, z=addition_5, Expression="Format(\"G1 X{0:0.00} Y{1:0.00} Z{2:0.00} F500\", x, y, z)")
degrees = Degrees(Radians=expression_3)
subtraction_7 = Subtraction(A=deconstruct_4.XComponent, B=29.1688)
subtraction_8 = Subtraction(A=deconstruct_4.YComponent, B=109.225)
ghpython_script = GhPythonScript(deg=degrees)  # -> out, a; inputs deg: list
# ---------- ghpython_script: Python ----------
# Input: deg - List of degree values (angles) from Grasshopper

# Step 1: Ensure deg is a list of floats (convert strings to floats)
deg = [float(x) for x in deg]  # Convert all input values to floats

# Step 2: Add an initial value of 0 at the start of the list
deg = [0.0] + deg  # Ensure initial value is a float

# Step 3: Initialize the final_deg list as a copy of deg
final_deg = deg[:]  # Create a copy using slicing

# Step 4: Initialize index tracking and b value
index = []  # To store the indices where adjustments occur
b = 1  # Index tracker

# Step 5: Loop through the degrees, starting from the second element
for i in range(1, len(deg)):  # Remember, Python indices are 0-based, so adjust accordingly
    if abs(deg[i] - deg[i - 1]) > 300:
        index.append(i)  # Save the index where the change happens
        if deg[i] - deg[i - 1] < 0:
            # If there's a large negative delta, add 360 to the remaining elements
            for j in range(i, len(final_deg)):
                final_deg[j] += 360
        elif deg[i] - deg[i - 1] > 0:
            # If there's a large positive delta, subtract 360 from the remaining elements
            for j in range(i, len(final_deg)):
                final_deg[j] -= 360

# Output the final corrected degrees and the index values
a = final_deg  # 'a' is the output for the final corrected degrees
b = index      # 'b' is the output for the indices where adjustments happened
# ---------- end ghpython_script ----------
panel_5 = Panel(expression_4)
split_list = SplitList(List=ghpython_script.a, Index=Slider(1, range=0..1))  # -> ListA, ListB
expression_5 = Expression(
    x=subtraction_7,
    y=subtraction_8,
    z=deconstruct_4.ZComponent,
    A=split_list.ListB,
    Expression="Format(\"G1 X{0:0.00} Y{1:0.00} Z{2:0.00} A{3:0.00} F600\", x, y, z, A)")
panel_6 = Panel([expression_5, panel_5])
