# Grasshopper definition Material_exploration.gh (Grasshopper 1.0.7)

number_slider = Slider(4, range=0..10)
number_slider_2 = Slider(50, range=0..100)
number_slider_3 = Slider(15, range=0..20)
number_slider_4 = Slider(4, range=0..10)
division = Division(A=number_slider_2, B=2)
addition = Addition(A=Slider(80, range=0..100), B=number_slider_3)
subtraction = Subtraction(A=number_slider_3, B=number_slider)
addition_2 = Addition(A=number_slider, B=addition)
subtraction_2 = Subtraction(A=0, B=number_slider)
addition_3 = Addition(A=number_slider, B=number_slider_2)
subtraction_3 = Subtraction(A=0, B=number_slider)
subtraction_4 = Subtraction(A=number_slider_3, B=number_slider)
subtraction_5 = Subtraction(A=division, B=number_slider_4)
subtraction_6 = Subtraction(A=subtraction_5, B=number_slider)
addition_4 = Addition(A=division, B=number_slider_4)
addition_5 = Addition(A=number_slider, B=addition_4)
construct_domain = ConstructDomain(DomainStart=number_slider_3, DomainEnd=addition)
construct_domain_2 = ConstructDomain(DomainStart=0, DomainEnd=number_slider_2)
construct_domain_3 = ConstructDomain(DomainStart=subtraction, DomainEnd=addition_2)
construct_domain_4 = ConstructDomain(DomainStart=subtraction_2, DomainEnd=addition_3)
construct_domain_5 = ConstructDomain(DomainStart=0, DomainEnd=number_slider_3)
construct_domain_6 = ConstructDomain(DomainStart=subtraction_3, DomainEnd=subtraction_4)
construct_domain_7 = ConstructDomain(DomainStart=subtraction_6, DomainEnd=addition_5)
construct_domain_8 = ConstructDomain(DomainStart=subtraction_5, DomainEnd=addition_4)
rectangle = Rectangle(Plane=PlaneXY(0, 0, 0), XSize=construct_domain, YSize=construct_domain_2, Radius=0)  # -> Rectangle, Length
rectangle_2 = Rectangle(Plane=PlaneXY(0, 0, 0), XSize=construct_domain_3, YSize=construct_domain_4, Radius=0)  # -> Rectangle, Length
rectangle_3 = Rectangle(Plane=PlaneXY(0, 0, 0), XSize=construct_domain_5, YSize=construct_domain_8, Radius=0)  # -> Rectangle, Length
rectangle_4 = Rectangle(Plane=PlaneXY(0, 0, 0), XSize=construct_domain_6, YSize=construct_domain_7, Radius=0)  # -> Rectangle, Length
explode = Explode(Curve=rectangle.Rectangle, Recursive=True)  # -> Segments, Vertices
explode_2 = Explode(Curve=rectangle_2.Rectangle, Recursive=True)  # -> Segments, Vertices
explode_3 = Explode(Curve=rectangle_3.Rectangle, Recursive=True)  # -> Segments, Vertices
explode_4 = Explode(Curve=rectangle_4.Rectangle, Recursive=True)  # -> Segments, Vertices
cull_duplicates = CullDuplicates(Points=explode.Vertices, Tolerance=0.1, CullMode=3)  # -> Points, Indices, Valence
cull_duplicates_2 = CullDuplicates(Points=explode_3.Vertices, Tolerance=0.1, CullMode=3)  # -> Points, Indices, Valence
cull_duplicates_3 = CullDuplicates(Points=explode_2.Vertices, Tolerance=0.1, CullMode=3)  # -> Points, Indices, Valence
cull_duplicates_4 = CullDuplicates(Points=explode_4.Vertices, Tolerance=0.1, CullMode=3)  # -> Points, Indices, Valence
shift_list = ShiftList(List=cull_duplicates.Points, Shift=Slider(3, range=0..5), Wrap=True)  # -> flatten(List)
shift_list_2 = ShiftList(List=cull_duplicates_2.Points, Shift=Slider(3, range=0..5), Wrap=True)
shift_list_3 = ShiftList(List=cull_duplicates_3.Points, Shift=Slider(3, range=0..5), Wrap=True)  # -> flatten(List)
shift_list_4 = ShiftList(List=cull_duplicates_4.Points, Shift=Slider(3, range=0..5), Wrap=True)
panel = Panel(shift_list_2)
panel_2 = Panel(shift_list)
panel_3 = Panel(shift_list_4)
panel_4 = Panel(shift_list_3)
split_list = SplitList(List=panel, Index=Slider(2, range=0..10))  # -> flatten(ListA), flatten(ListB)
split_list_2 = SplitList(List=panel_3, Index=Slider(2, range=0..10))  # -> flatten(ListA), flatten(ListB)
point = Point([split_list.ListA, panel_2, split_list.ListB])
point_2 = Point([split_list_2.ListA, panel_4, split_list_2.ListB])
panel_5 = Panel(point)
panel_6 = Panel(point_2)
number_slider_5 = Slider(662, range=0..1000)
polyline = PolyLine(Vertices=point_2, Closed=False)
polyline_2 = PolyLine(Vertices=point, Closed=False)
divide_curve = DivideCurve(Curve=polyline_2, Count=number_slider_5, Kinks=False)  # -> Points, Tangents, Parameters
divide_curve_2 = DivideCurve(Curve=polyline, Count=number_slider_5, Kinks=False)  # -> Points, Tangents, Parameters
deconstruct_vector = DeconstructVector(Vector=divide_curve_2.Tangents)  # -> XComponent, YComponent, ZComponent
deconstruct = Deconstruct(Point=divide_curve_2.Points)  # -> XComponent, YComponent, ZComponent
expression = Expression(x=deconstruct_vector.XComponent, y=deconstruct_vector.YComponent, Expression="if(y<0,2*pi+atan2(y,x),atan2(y,x))")
radians = Radians(Degrees=Slider(0, range=0..8))
degrees = Degrees(Radians=expression)
subtraction_7 = Subtraction(A=deconstruct.XComponent, B=Slider(27.6313, range=0..100))
subtraction_8 = Subtraction(A=deconstruct.YComponent, B=Slider(110.4688, range=0..1000))
yz_plane = YZPlane(Origin=Point(0, 0, 0))
radians_2 = Radians(Degrees=Slider(0.07, range=0..0.1))
ghpython_script = GhPythonScript(deg=degrees)  # -> out, a; inputs deg: list
# ---------- ghpython_script: Python ----------
# Input: deg - List of degree values (angles) from Grasshopper

# Step 1: Ensure deg is a list of floats (convert strings to floats)
deg = [float(x) for x in deg]  # Convert all input values to floats

# Step 2: Add an initial value of 0 at the start of the list
deg = [0.0] + deg  # Ensure initial value is a float

# Step 3: Initialize the final_deg list as a copy of deg
final_deg = deg[:]  # Create a copy using slicing

# Step 4: Initialize index tracking and b value
index = []  # To store the indices where adjustments occur
b = 1  # Index tracker

# Step 5: Loop through the degrees, starting from the second element
for i in range(1, len(deg)):  # Remember, Python indices are 0-based, so adjust accordingly
    if abs(deg[i] - deg[i - 1]) > 300:
        index.append(i)  # Save the index where the change happens
        if deg[i] - deg[i - 1] < 0:
            # If there's a large negative delta, add 360 to the remaining elements
            for j in range(i, len(final_deg)):
                final_deg[j] += 360
        elif deg[i] - deg[i - 1] > 0:
            # If there's a large positive delta, subtract 360 from the remaining elements
            for j in range(i, len(final_deg)):
                final_deg[j] -= 360

# Output the final corrected degrees and the index values
a = final_deg  # 'a' is the output for the final corrected degrees
b = index      # 'b' is the output for the indices where adjustments happened
# ---------- end ghpython_script ----------
negative = Negative(Value=radians_2)
rotate = Rotate(Geometry=divide_curve.Points, Angle=radians, Plane=yz_plane)  # -> Geometry, Transform
split_list_3 = SplitList(List=ghpython_script.a, Index=Slider(1, range=0..1))  # -> ListA, ListB
xz_plane = XZPlane(Origin=Point(0, 0, 0))
expression_2 = Expression(
    x=subtraction_7,
    y=subtraction_8,
    z=deconstruct.ZComponent,
    A=split_list_3.ListB,
    Expression="Format(\"G1 X{0:0.00} Y{1:0.00} Z{2:0.00} A{3:0.00} F600\", x, y, z, A)")
rotate_2 = Rotate(Geometry=rotate.Geometry, Angle=negative, Plane=xz_plane)  # -> Geometry, Transform
deconstruct_2 = Deconstruct(Point=rotate_2.Geometry)  # -> XComponent, YComponent, ZComponent
expression_3 = Expression(
    x=deconstruct_2.XComponent,
    y=deconstruct_2.YComponent,
    z=deconstruct_2.ZComponent,
    Expression="Format(\"G1 X{0:0.00} Y{1:0.00} Z{2:0.00} F160\", x, y, z)")
panel_7 = Panel(expression_2)
panel_8 = Panel(expression_3)
