# Grasshopper definition SVG-DXF-DWG_2_GCode.gh (Grasshopper 1.0.7)

# ---- group: Weld input
point_distance = Slider(0.2, range=0..5)
weld_speed = Slider(160, range=0..1000)
welding_lines = Curve([<curve referenced from the Rhino model> x64])

# ---- group: Cutter input
x_axis_offset = Slider(25, range=0..100)
y_axis_offset = Slider(25, range=0..100)
cut_distance = Slider(0.2, range=0..5)
cut_speed = Slider(600, range=0..1000)
outer_cutting_lines = Curve(<curve referenced from the Rhino model>)
inner_cutting_lines = Curve([<curve referenced from the Rhino model> x10])

# ---- group: moving to zero
bounding_box = BoundingBox(Content=outer_cutting_lines, Plane=PlaneXY(0, 0, 0), UnionBox=True)  # -> Box, Box_2
deconstruct_brep = DeconstructBrep(Brep=bounding_box.Box)  # -> Faces, Edges, Vertices
construct_point = ConstructPoint(XCoordinate=0, YCoordinate=0, ZCoordinate=0)
list_item = ListItem(List=deconstruct_brep.Vertices, Index=0, Wrap=True)
vector_2pt = Vector2Pt(PointA=list_item, PointB=construct_point, Unitize=False)  # -> Vector, Length

# ----
weld_line = Move(Geometry=welding_lines, Motion=vector_2pt.Vector)  # -> Geometry, Transform
outer_cut = Move(Geometry=outer_cutting_lines, Motion=vector_2pt.Vector)  # -> Geometry, Transform
inner_cut = Move(Geometry=inner_cutting_lines, Motion=vector_2pt.Vector)  # -> Geometry, Transform

# ---- group: Welding Gcode
divide_distance = DivideDistance(Curve=weld_line.Geometry, Distance=point_distance)  # -> simplify(Points), Tangents, Parameters
unit_z = UnitZ(Factor=Slider(2, range=0..10))
list_item_2 = ListItem(List=divide_distance.Points, Index=0, Wrap=True)
list_item_3 = ListItem(List=divide_distance.Points, Index="-1", Wrap=True)
move = Move(Geometry=list_item_2, Motion=unit_z)  # -> Geometry, Transform
move_2 = Move(Geometry=list_item_3, Motion=unit_z)  # -> Geometry, Transform
point = Point([move.Geometry, divide_distance.Points, move_2.Geometry])
deconstruct = Deconstruct(Point=point)  # -> XComponent, YComponent, ZComponent
expression = Expression(
    x=deconstruct.XComponent,
    y=deconstruct.YComponent,
    z=deconstruct.ZComponent,
    f=weld_speed,
    Expression="Format(\"G1 X{0:0.00} Y{1:0.00} Z{2:0.00} F{3:0.0}\", x, y, z, f)")
list_length = ListLength(List=deconstruct.XComponent)
tree_statistics = TreeStatistics(Tree=list_length)  # -> Paths, Length, Count
repeat_data = RepeatData(Data="M9", Length=tree_statistics.Count)  # -> simplify(graft(Data))
repeat_data_2 = RepeatData(Data="M7", Length=tree_statistics.Count)  # -> simplify(graft(Data))
panel = Panel([repeat_data_2, expression, repeat_data])
flatten_tree = FlattenTree(Tree=panel, Path="{0}")
panel_2 = Panel(flatten_tree)

# ----
path_mapper = PathMapper("; Add tool change code here", source="{A}", target="{A+3}")
path_mapper_2 = PathMapper("; Add your personal start Gcode here", source="{A}", target="{A}")
path_mapper_3 = PathMapper(panel_2, source="{A}", target="{A+1}")
path_mapper_4 = PathMapper("; Add your personal End Gcode here", source="{A}", target="{A+5}")

# ---- group: External Cut Gcode
divide_length = DivideLength(Curve=outer_cut.Geometry, Length=cut_distance)  # -> Points, Tangents, Parameters
unit_z_2 = UnitZ(Factor=Slider(2, range=0..10))
list_item_4 = ListItem(List=divide_length.Points, Index=0, Wrap=True)
list_item_5 = ListItem(List=divide_length.Points, Index="-1", Wrap=True)
move_3 = Move(Geometry=list_item_4, Motion=unit_z_2)  # -> Geometry, Transform
move_4 = Move(Geometry=list_item_5, Motion=unit_z_2)  # -> Geometry, Transform
point_2 = Point(simplify([move_3.Geometry, divide_length.Points, move_4.Geometry]))
deconstruct_2 = Deconstruct(Point=point_2)  # -> XComponent, YComponent, ZComponent
addition = Addition(A=deconstruct_2.YComponent, B=y_axis_offset)
addition_2 = Addition(A=deconstruct_2.XComponent, B=x_axis_offset)

# ---- group: External Cut Gcode / Knife Angle
deconstruct_vector = DeconstructVector(Vector=divide_length.Tangents)  # -> XComponent, YComponent, ZComponent
expression_2 = Expression(x=deconstruct_vector.XComponent, y=deconstruct_vector.YComponent, Expression="(atan2(y,x))")
degrees = Degrees(Radians=expression_2)  # -> simplify(Degrees)
ghpython_script = GhPythonScript(angles=degrees)  # -> out, unwrapped; inputs angles: list
# ---------- ghpython_script: Python ----------
# Inputs:
# angles: list of string (your original angles)

# Outputs:
# unwrapped: list of float (continuous angles)

# Filter out invalid entries and convert
print(angles)

clean_angles = []
for a in angles:
    try:
        clean_angles.append(float(a))
    except:
        pass  # Ignore anything that can't be converted to a float

unwrapped = []

if len(clean_angles) == 0:
    unwrapped = []
else:
    unwrapped.append(clean_angles[0])  # Start with the first angle
    for i in range(1, len(clean_angles)):
        prev = unwrapped[i - 1]
        current = clean_angles[i]
        delta = current - prev

        if delta > 180:
            current -= 360
        elif delta < -180:
            current += 360

        unwrapped.append(current)
# ---------- end ghpython_script ----------

# ---- group: External Cut Gcode (continued)
list_item_6 = ListItem(List=ghpython_script.unwrapped, Index=0, Wrap=True)
list_item_7 = ListItem(List=ghpython_script.unwrapped, Index="-1", Wrap=True)
number = Number([list_item_6, ghpython_script.unwrapped, list_item_7])
expression_3 = Expression(
    x=addition_2,
    y=addition,
    z=deconstruct_2.ZComponent,
    A=number,
    f=cut_speed,
    Expression="Format(\"G1 X{0:0.00} Y{1:0.00} Z{2:0.00} A{3:0.00} F{4:0.0}\", x, y, z, A, f)")

# ----
flatten_tree_2 = FlattenTree(Tree=expression_3, Path="{0}")
path_mapper_5 = PathMapper(flatten_tree_2, source="{A}", target="{A+4}")

# ---- group: Internal Cut Gcode
divide_length_2 = DivideLength(Curve=inner_cut.Geometry, Length=cut_distance)  # -> simplify(Points), Tangents, Parameters
unit_z_3 = UnitZ(Factor=Slider(2, range=0..10))
list_item_8 = ListItem(List=divide_length_2.Points, Index=0, Wrap=True)
list_item_9 = ListItem(List=divide_length_2.Points, Index="-1", Wrap=True)
move_5 = Move(Geometry=list_item_8, Motion=unit_z_3)  # -> Geometry, Transform
move_6 = Move(Geometry=list_item_9, Motion=unit_z_3)  # -> Geometry, Transform
point_3 = Point([move_5.Geometry, divide_length_2.Points, move_6.Geometry])
deconstruct_3 = Deconstruct(Point=point_3)  # -> XComponent, YComponent, ZComponent
addition_3 = Addition(A=deconstruct_3.YComponent, B=y_axis_offset)
addition_4 = Addition(A=deconstruct_3.XComponent, B=x_axis_offset)

# ---- group: Internal Cut Gcode / Knife Angle
deconstruct_vector_2 = DeconstructVector(Vector=divide_length_2.Tangents)  # -> XComponent, YComponent, ZComponent
expression_4 = Expression(x=deconstruct_vector_2.XComponent, y=deconstruct_vector_2.YComponent, Expression="(atan2(y,x))")
degrees_2 = Degrees(Radians=expression_4)  # -> simplify(Degrees)
ghpython_script_2 = GhPythonScript(angles=degrees_2)  # -> out, unwrapped; inputs angles: list; same code as ghpython_script

# ---- group: Internal Cut Gcode (continued)
list_item_10 = ListItem(List=ghpython_script_2.unwrapped, Index=0, Wrap=True)
list_item_11 = ListItem(List=ghpython_script_2.unwrapped, Index="-1", Wrap=True)
number_2 = Number([list_item_10, ghpython_script_2.unwrapped, list_item_11])
expression_5 = Expression(
    x=addition_4,
    y=addition_3,
    z=deconstruct_3.ZComponent,
    A=number_2,
    f=cut_speed,
    Expression="Format(\"G1 X{0:0.00} Y{1:0.00} Z{2:0.00} A{3:0.00} F{4:0.0}\", x, y, z, A, f)")

# ----
flatten_tree_3 = FlattenTree(Tree=expression_5, Path="{0}")
path_mapper_6 = PathMapper(flatten_tree_3, source="{A}", target="{A+3}")
panel_3 = Panel([path_mapper_2, path_mapper_5, path_mapper_6, path_mapper_3, path_mapper_4, path_mapper])
