# Grasshopper definition contraction_nocut.gh (Grasshopper 1.0.7)

number_slider = Slider(6, range=0..10)
number_slider_2 = Slider(40, range=0..100)
number_slider_3 = Slider(120, range=0..200)
addition = Addition(A=number_slider_3, B="5")
addition_2 = Addition(A=number_slider_2, B="5")
division = Division(A=number_slider_2, B=2)
construct_domain = ConstructDomain(DomainStart="-5", DomainEnd=addition_2)
construct_domain_2 = ConstructDomain(DomainStart="-5", DomainEnd=addition)
rectangle = Rectangle(Plane=PlaneXY(0, 0, 0), XSize=number_slider_3, YSize=number_slider_2, Radius=0)  # -> Rectangle, Length
subtraction = Subtraction(A=division, B=Slider(4, range=0..10))
division_2 = Division(A=number_slider_3, B=number_slider)
rectangle_2 = Rectangle(Plane=PlaneXY(0, 0, 0), XSize=construct_domain_2, YSize=construct_domain, Radius=0)  # -> Rectangle, Length
construct_point = ConstructPoint(XCoordinate=division_2, YCoordinate=subtraction, ZCoordinate=0)
construct_point_2 = ConstructPoint(XCoordinate=division_2, YCoordinate=0, ZCoordinate=0)
construct_point_3 = ConstructPoint(XCoordinate=0, YCoordinate=division, ZCoordinate=0)
divide_length = DivideLength(Curve=rectangle_2.Rectangle, Length=Slider(1, range=0..1))  # -> Points, Tangents, Parameters
divide_length_2 = DivideLength(Curve=rectangle.Rectangle, Length=Slider(0.4, range=0..2))  # -> Points, Tangents, Parameters
line = Line(StartPoint=construct_point_2, EndPoint=construct_point)
deconstruct_vector = DeconstructVector(Vector=divide_length.Tangents)  # -> XComponent, YComponent, ZComponent
xz_plane = XZPlane(Origin=construct_point_3)
list_item = ListItem(List=divide_length_2.Points, Index=0, Wrap=True)
expression = Expression(x=deconstruct_vector.XComponent, y=deconstruct_vector.YComponent, Expression="if(y<0,2*pi+atan2(y,x),atan2(y,x))")
deconstruct = Deconstruct(Point=divide_length.Points)  # -> XComponent, YComponent, ZComponent
series = Series(Start=0, Step=division, Count=expr("x-1", number_slider))  # -> graft(Series)
unit_z = UnitZ(Factor=Slider(5, range=0..10))
point = Point([divide_length_2.Points, list_item])
degrees = Degrees(Radians=expression)
move = Move(Geometry=list_item, Motion=unit_z)  # -> Geometry, Transform
unit_x = UnitX(Factor=series)
subtraction_2 = Subtraction(A=deconstruct.XComponent, B=29.1688)
subtraction_3 = Subtraction(A=deconstruct.YComponent, B=109.225)
path_mapper = PathMapper(move.Geometry, source="{0;0}", target="{0;1}")
move_2 = Move(Geometry=line, Motion=unit_x)  # -> Geometry, Transform
ghpython_script = GhPythonScript(deg=degrees)  # -> out, a; inputs deg: list
# ---------- ghpython_script: Python ----------
# Input: deg - List of degree values (angles) from Grasshopper

# Step 1: Ensure deg is a list of floats (convert strings to floats)
deg = [float(x) for x in deg]  # Convert all input values to floats

# Step 2: Add an initial value of 0 at the start of the list
deg = [0.0] + deg  # Ensure initial value is a float

# Step 3: Initialize the final_deg list as a copy of deg
final_deg = deg[:]  # Create a copy using slicing

# Step 4: Initialize index tracking and b value
index = []  # To store the indices where adjustments occur
b = 1  # Index tracker

# Step 5: Loop through the degrees, starting from the second element
for i in range(1, len(deg)):  # Remember, Python indices are 0-based, so adjust accordingly
    if abs(deg[i] - deg[i - 1]) > 300:
        index.append(i)  # Save the index where the change happens
        if deg[i] - deg[i - 1] < 0:
            # If there's a large negative delta, add 360 to the remaining elements
            for j in range(i, len(final_deg)):
                final_deg[j] += 360
        elif deg[i] - deg[i - 1] > 0:
            # If there's a large positive delta, subtract 360 from the remaining elements
            for j in range(i, len(final_deg)):
                final_deg[j] -= 360

# Output the final corrected degrees and the index values
a = final_deg  # 'a' is the output for the final corrected degrees
b = index      # 'b' is the output for the indices where adjustments happened
# ---------- end ghpython_script ----------
split_list = SplitList(List=ghpython_script.a, Index=Slider(1, range=0..1))  # -> ListA, ListB
panel = Panel(split_list.ListB)
expression_2 = Expression(
    x=subtraction_2,
    y=subtraction_3,
    z=deconstruct.ZComponent,
    A=panel,
    Expression="Format(\"G1 X{0:0.00} Y{1:0.00} Z{2:0.00} A{3:0.00} F600\", x, y, z, A)")
divide_length_3 = DivideLength(Curve=move_2.Geometry, Length=Slider(1, range=0..1))  # -> Points, Tangents, Parameters
list_item_2 = ListItem(List=divide_length_3.Points, Index="-1", Wrap=True)
list_item_3 = ListItem(List=divide_length_3.Points, Index=0, Wrap=True)
unit_z_2 = UnitZ(Factor=5)
move_3 = Move(Geometry=list_item_3, Motion=unit_z_2)  # -> Geometry, Transform
move_4 = Move(Geometry=list_item_2, Motion=unit_z_2)  # -> Geometry, Transform
path_mapper_2 = PathMapper(divide_length_3.Points, source="{0;0;A;0}", target="{0;3*A+3}")
path_mapper_3 = PathMapper(move_4.Geometry, source="{0;0;A;0}", target="{0;3*A+4}")
path_mapper_4 = PathMapper(move_3.Geometry, source="{0;0;A;0}", target="{0;3*A+2}")
panel_2 = Panel([path_mapper_4, path_mapper_2, path_mapper_3])
panel_3 = Panel(expression_2)
mirror = Mirror(Geometry=panel_2, Plane=xz_plane)  # -> Geometry, Transform
panel_4 = Panel(mirror.Geometry)
path_mapper_5 = PathMapper(panel_4, source="{0;A}", target="{0;A+15}")
panel_5 = Panel(path_mapper_5)
panel_6 = Panel([point, path_mapper, panel_2, panel_5])
scale = Scale(Geometry=panel_6, Center=Point(0, 0, 0), Factor=Slider(1.5, range=0..10))  # -> Geometry, Transform
rotate = Rotate(Geometry=scale.Geometry, Angle=1.570796327, Plane=PlaneXY(0, 0, 0))  # -> Geometry, Transform
radians = Radians(Degrees=Slider(0.16, range=0..1))
mirror_2 = Mirror(Geometry=rotate.Geometry, Plane=PlaneYZ(0, 0, 0))  # -> Geometry, Transform
negative = Negative(Value=radians)
yz_plane = YZPlane(Origin=Point(0, 0, 0))
rotate_2 = Rotate(Geometry=mirror_2.Geometry, Angle=negative, Plane=yz_plane)  # -> Geometry, Transform
deconstruct_2 = Deconstruct(Point=rotate_2.Geometry)  # -> XComponent, YComponent, ZComponent
expression_3 = Expression(
    x=deconstruct_2.XComponent,
    y=deconstruct_2.YComponent,
    z=deconstruct_2.ZComponent,
    Expression="Format(\"G1 X{0:0.00} Y{1:0.00} Z{2:0.00} F120\", x, y, z)")
panel_7 = Panel(expression_3)
